# Grasshopper definition ghexample.gh (Grasshopper 1.0.7)
# plug-ins: TopoGrasshopper Info

pwd = VBScript()  # -> out, Path
# ---------- pwd: VB ----------
    Dim gh_d As GH_Document = owner.OnPingDocument()

    If gh_d.IsFilePathDefined Then
      Print("A path is defined.")
      Path = gh_d.FilePath
    Else
      Print("No path defined.")
    End If
# ---------- end pwd ----------
pwd_2 = VBScript()  # -> out, Path; same code as pwd
relative_exact = GhPythonScript(A=pwd.Path, B="model/fig_teaser/origin.xml")  # -> Path
# ---------- relative_exact: Python ----------
__author__ = "ziqwang"

import rhinoscriptsyntax as rs

import os

Path = os.path.join(os.path.dirname(A), os.path.normpath(B))
# ---------- end relative_exact ----------
relative_exact_2 = GhPythonScript(A=pwd_2.Path, B="model/fig_intro_sphere/SphereA80_Quad_T0.08.xml")  # -> Path; same code as relative_exact
toggle = BooleanToggle(True)
pt = Point(Point(2.5, 0, 0))
topocreator = TopoGrasshopperComponent(XMLFile=relative_exact, TiltAngle=Slider(47, range=0..80), Preview=toggle)  # -> NumberOfPart, Meshes
topocreator_2 = TopoGrasshopperComponent(XMLFile=relative_exact_2, TiltAngle=Slider(40, range=0..80), Preview=toggle)  # -> NumberOfPart, Meshes
move = Move(Geometry=topocreator_2.Meshes, Motion=pt)  # -> Geometry, Transform
rgb = ColourRGB(Alpha="110", Red="110", Green="110", Blue="110")
rgb_2 = ColourRGB(Alpha="250", Red="250", Green="250", Blue="250")
material = CreateMaterial(Diffuse=rgb_2, Specular=rgb, Emission=rgb, Transparency=0, Shine=0)
preview = CustomPreview(Geometry=topocreator.Meshes, Material=material)
faceb = FaceBoundaries(Mesh=[topocreator.Meshes, move.Geometry])
preview_2 = CustomPreview(Geometry=move.Geometry, Material=material)
